# Grasshopper definition CW-04_GH.gh (Grasshopper 1.0.8)
# plug-ins: Speckle.Connector.Grasshopper

# ----
# Disclaimer: Scripted by María Sánchez Domínguez
# INPUTS
# OUTPUTS
# EXPORT
# OPERATIONS
panel = Panel("http://james-ramsden.com/change-the-colour-of-the-grasshopper-canvas/")
c_script = CSharpScript(
    switcher=Toggle(True),
    canvasBack=ColourSwatch(SwatchColor=RGB(54, 54, 54)),
    canvasGrid=ColourSwatch(SwatchColor=RGB(105, 105, 105)),
    canvasEdge=ColourSwatch(SwatchColor=RGB(255, 255, 255)),
    canvasShade=ColourSwatch(SwatchColor=RGBA(255, 0, 166, 88)))  # -> out; inputs switcher: Boolean, canvasBack: Color, canvasGrid: Color, canvasEdge: Color, canvasShade: Color
# ---------- c_script: C# ----------
// Grasshopper Script Instance

using System;
using System.Collections;
using System.Collections.Generic;

using Rhino;
using Rhino.Geometry;

using Grasshopper;
using Grasshopper.Kernel;
using Grasshopper.Kernel.Data;
using Grasshopper.Kernel.Types;

using System.Drawing;

/// <summary>
/// This class will be instantiated on demand by the Script component.
/// </summary>
public class Script_Instance : GH_ScriptInstance
{
  /// <summary>Print a String to the [Out] Parameter of the Script component.</summary>
  /// <param name="text">String to print.</param>
  private void Print(string text) { /* Implementation hidden. */ }
  /// <summary>Print a formatted String to the [Out] Parameter of the Script component.</summary>
  /// <param name="format">String format.</param>
  /// <param name="args">Formatting parameters.</param>
  private void Print(string format, params object[] args) { /* Implementation hidden. */ }
  /// <summary>Print useful information about an object instance to the [Out] Parameter of the Script component. </summary>
  /// <param name="obj">Object instance to parse.</param>
  private void Reflect(object obj) { /* Implementation hidden. */ }
  /// <summary>Print the signatures of all the overloads of a specific method to the [Out] Parameter of the Script component. </summary>
  /// <param name="obj">Object instance to parse.</param>
  private void Reflect(object obj, string method_name) { /* Implementation hidden. */ }

  /// <summary>Gets the current Rhino document.</summary>
  private readonly RhinoDoc RhinoDocument;
  /// <summary>Gets the Grasshopper document that owns this script.</summary>
  private readonly GH_Document GrasshopperDocument;
  /// <summary>Gets the Grasshopper script component that owns this script.</summary>
  private readonly IGH_Component Component;
  /// <summary>
  /// Gets the current iteration count. The first call to RunScript() is associated with Iteration==0.
  /// Any subsequent call within the same solution will increment the Iteration count.
  /// </summary>
  private readonly int Iteration;

  /// <summary>
  /// This procedure contains the user code. Input parameters are provided as regular arguments,
  /// Output parameters as ref arguments. You don't have to assign output parameters,
  /// they will have a default value.
  /// </summary>
  private void RunScript(
		bool switcher,
		Color canvasBack,
		Color canvasGrid,
		Color canvasEdge,
		Color canvasShade)
  {

    if (switcher == true)
    {
      Grasshopper.GUI.Canvas.GH_Skin.canvas_back = canvasBack;
      Grasshopper.GUI.Canvas.GH_Skin.canvas_grid = canvasGrid;
      Grasshopper.GUI.Canvas.GH_Skin.canvas_edge = canvasEdge;
      Grasshopper.GUI.Canvas.GH_Skin.canvas_shade = canvasShade;
    }
    else
    {
      Grasshopper.GUI.Canvas.GH_Skin.canvas_back = Color.FromArgb(212, 208, 200);
      Grasshopper.GUI.Canvas.GH_Skin.canvas_grid = Color.FromArgb(30, 0, 0, 0);
      Grasshopper.GUI.Canvas.GH_Skin.canvas_edge = Color.FromArgb(0, 0, 0);
      Grasshopper.GUI.Canvas.GH_Skin.canvas_shade = Color.FromArgb(80, 0, 0, 0);
    }

  }

  // <Custom additional code> 


  /// <summary>
  /// This method will be called once every solution, before any calls to RunScript.
  /// </summary>
  public override void BeforeRunScript()
  { }
  /// <summary>
  /// This method will be called once every solution, after any calls to RunScript.
  /// </summary>
  public override void AfterRunScript()
  { }

  // </Custom additional code> 
}
# ---------- end c_script ----------

colour = ColourPicker(PickedColour=RGB(189, 47, 47))
cir = Circle(Plane=PlaneXY(0, 0, 0), Radius=Slider(2.2, range=0..10))
Z = UnitZ(Factor=Slider(26.2, range=10..30))
extr = Extrude(Base=cir, Direction=Z)
cap = CapHoles(Brep=extr)
speckle_geometry = SpeckleGeometry(Geometry=cap, Name="Team01.1", Color=colour)  # -> SpeckleGeometry, Geometry, Name, Properties, Color, Material, Path
speckle_model = SpeckleModel(
    Model="15d75b29a8",
    Project="128262a20c",
    Server="https://app.speckle.systems",
    User="B7D4FFDCE8A16C4E620A937ACC205929",
    Workspace="a1cd06bae2")
create_collection = CreateCollection(SubCollection1=speckle_geometry.Geometry, AlwaysInheritNames=False)
publish = Publish(SpeckleModel=speckle_model, Collection=create_collection)
