# Grasshopper definition LoadSpeckleGeometry.gh (Grasshopper 1.0.8)
# plug-ins: Speckle.Connector.Grasshopper

panel = Panel("https://app.speckle.systems/projects/128262a20c/models/a1014e4b32")
sign_in = SignIn()
speckle_model = SpeckleModel(
    SpeckleUrl=panel,
    Model="2f610c778d",
    Project="128262a20c",
    Server="https://app.speckle.systems",
    User="B7D4FFDCE8A16C4E620A937ACC205929",
    Workspace="a1cd06bae2")
panel_2 = Panel("https://app.speckle.systems/projects/128262a20c/models/0fc383dd86")
L = Load(SpeckleModel=speckle_model, AutoReceive=False)  # -> Collection, Properties
speckle_model_2 = SpeckleModel(
    SpeckleUrl=panel_2,
    Model="2a22af03b7",
    Project="128262a20c",
    Server="https://app.speckle.systems",
    User="B7D4FFDCE8A16C4E620A937ACC205929",
    Workspace="a1cd06bae2")
publish = Publish(SpeckleModel=speckle_model_2, Collection=L.Collection, Properties=L.Properties)
